# Grasshopper definition Coding for Theatre.gh (Grasshopper 0.9.76)
# plug-ins: Exoskeleton

# boundries of the Voronoi
# 
# Make a web, or create balls of voronoi
# 
# Roof?
# 
# How to make the floor of the asscention room hit ground level on the back level
number_slider = Slider(6, range=0..10)
number_slider_2 = Slider(28, range=0..100)  # disabled
crv = Curve(<curve referenced from the Rhino model>)
rooms = Curve([<curve referenced from the Rhino model> x8])
bathrooms = Curve([<curve referenced from the Rhino model> x6])
crv_2 = Curve(<curve referenced from the Rhino model>)
srf = Surface(crv)
srf_2 = Surface(simplify(graft(bathrooms)))
srf_3 = Surface(simplify(graft(rooms)))
Z = UnitZ(Factor=number_slider)
srf_4 = Surface(crv_2)
Z_2 = UnitZ(Factor=Slider(3, range=0..5))
Z_3 = UnitZ(Factor=Slider(6, range=0..10))
bbox = BoundingBox(Content=crv, Plane=PlaneXY(0, 0, 0))  # -> Box, Box_2; disabled
popgeo = PopulateGeometry(Geometry=srf, Count=Slider(18, range=0..100), Seed=Slider(4, range=0..10))
move = Move(Geometry=srf_4, Motion=Z)  # -> Geometry, Transform
move_2 = Move(Geometry=srf_2, Motion=Z_2)  # -> simplify(graft(Geometry)), Transform
move_3 = Move(Geometry=srf_3, Motion=Z_3)  # -> simplify(graft(Geometry)), Transform
pop2d = Populate2D(Region=bbox.Box, Count=number_slider_2, Seed=1)  # disabled
voronoi = Voronoi(Points=popgeo, BruteForceOverride=False)
loft = Loft(
    Curves=[srf_4, move.Geometry],
    Options={Adjust=False, Closed=False, LoftEnds=0, LoftSimp=0, LoftType=0, Rebuild=10, Refit=0.01})
panel = Panel(".http://www.grasshopper3d.com/forum/topics/inside-voronoi-cells-selection")
rint = RegionIntersection(CurvesA=graft(voronoi), CurvesB=crv)
vorgroup = VoronoiGroups(Boundary=bbox.Box, Generation1=pop2d)  # disabled
loft_2 = Loft(
    Curves=[srf_2, move_2.Geometry],
    Options={Adjust=False, Closed=False, LoftEnds=0, LoftSimp=0, LoftType=0, Rebuild=10, Refit=0.01})
loft_3 = Loft(
    Curves=[srf_3, move_3.Geometry],
    Options={Adjust=False, Closed=False, LoftEnds=0, LoftSimp=0, LoftType=0, Rebuild=10, Refit=0.01})
cap = CapHoles(Brep=loft)
cap_2 = CapHoles(Brep=loft_2)
cap_3 = CapHoles(Brep=loft_3)
brep = Brep(cap)
pt = Point(<point referenced from the Rhino model>)
rint_2 = RegionIntersection(CurvesA=graft(vorgroup), CurvesB=crv)  # disabled
pt_2 = Point(<point referenced from the Rhino model>)
area = Area(Geometry=[srf_2, srf_3])  # -> simplify(flatten(Area)), Centroid
brep_2 = Brep(cap_2)
brep_3 = Brep(cap_3)
popgeo_2 = PopulateGeometry(Geometry=brep, Count=Slider(70, range=0..100), Seed=1)
prox_max = Slider(10, range=0..10)
prox_min = Slider(0, range=0..10)
voronoi³ = Voronoi3D(Points=popgeo_2, Box=brep)  # -> Cells, Boundary
ma = MassAddition(Input=area.Area)  # -> Result, PartialResults
crv_3 = Curve([<curve referenced from the Rhino model> x2])
volume = Volume(Geometry=voronoi³.Cells)  # -> Volume, Centroid
explode = Explode(Curve=rint, Recursive=True)  # -> reparameterize(Segments), Vertices
panel_2 = Panel(ma.Result)
srf_5 = Surface(crv_3)
dom = ConstructDomain(DomainStart=prox_max, DomainEnd=prox_min)
dist = Distance(PointA=pt_2, PointB=volume.Centroid)

prox_min_2 = Slider(0, range=0..10)
prox_max_2 = Slider(5, range=0..10)
dom_2 = ConstructDomain(DomainStart=prox_min_2, DomainEnd=prox_max_2)
remap = RemapNumbers(Value=dist, Source=dom_2, Target=Domain(0, 1))  # -> Mapped, Clipped
max_height = Slider(0.9, range=0..1.3)
min_height = Slider(0.15, range=0..1)
graph = GraphMapper(
    remap.Mapped,
    x0=0,
    x1=1,
    y0=0,
    y1=1,
    container_name="Sine",
    Equation_px=[0.2018020153, 1],
    Equation_py=[0.01954871416, 1])
dom_3 = ConstructDomain(DomainStart=max_height, DomainEnd=min_height)
remap_2 = RemapNumbers(Value=graph, Source=Domain(0, 1), Target=dom_3)  # -> Mapped, Clipped

eval = EvaluateCurve(Curve=explode.Segments, Parameter=0.5)  # -> Point, Tangent, Angle
join = BrepJoin(Breps=srf_5)  # -> Breps, Closed
remap_3 = RemapNumbers(Value=dist, Source=dom, Target=Domain(0, 1))  # -> Mapped, Clipped
brep_cp = BrepClosestPoint(Point=eval.Point, Brep=join.Breps)  # -> Point, Distance
max_height_2 = Slider(0.8, range=0..5)
min_height_2 = Slider(0, range=0..5)
graph_2 = GraphMapper(remap_3.Mapped, x0=0, x1=1, y0=0, y1=1, container_name="Bezier", cpx=[0, 0.25, 0.75, 1], cpy=[0, 0.25, 0.75, 1])
smaller = SmallerThan(FirstNumber=brep_cp.Distance, SecondNumber=0.1)  # -> SmallerThan, OrEqualTo
dom_4 = ConstructDomain(DomainStart=max_height_2, DomainEnd=min_height_2)
ma_2 = MassAddition(Input=smaller.SmallerThan)  # -> Result, PartialResults
dispatch = Dispatch(List=rint, DispatchPattern=ma_2.Result)  # -> ListA, ListB
area_2 = Area(Geometry=dispatch.ListB)  # -> Area, Centroid
dist_2 = Distance(PointA=pt, PointB=area_2.Centroid)

prox_min_3 = Slider(0, range=0..10)
prox_max_3 = Slider(5, range=0..10)
dom_5 = ConstructDomain(DomainStart=prox_min_3, DomainEnd=prox_max_3)
remap_4 = RemapNumbers(Value=dist_2, Source=dom_5, Target=Domain(0, 1))  # -> Mapped, Clipped
max_height_3 = Slider(3, range=0..5)
min_height_3 = Slider(0, range=0..5)
graph_3 = GraphMapper(
    remap_4.Mapped,
    x0=0,
    x1=1,
    y0=0,
    y1=1,
    A=0.7419662965,
    B=0.1774434447,
    container_name="Linear",
    Graph_x0=0,
    Graph_x1=0.7782610655,
    Graph_y0=0.1774434447,
    Graph_y1=0.7548869252)
dom_6 = ConstructDomain(DomainStart=max_height_3, DomainEnd=min_height_3)
remap_5 = RemapNumbers(Value=graph_3, Source=Domain(0, 1), Target=dom_6)  # -> Mapped, Clipped
Z_4 = UnitZ(Factor=remap_5.Mapped)
move_4 = Move(Geometry=dispatch.ListB, Motion=Z_4)  # -> Geometry, Transform

remap_6 = RemapNumbers(Value=graph_2, Source=Domain(0, 1), Target=dom_4)  # -> Mapped, Clipped
scale = Scale(Geometry=voronoi³.Cells, Center=volume.Centroid, Factor=remap_6.Mapped)  # -> Geometry, Transform
scale_2 = Scale(Geometry=voronoi³.Cells, Center=volume.Centroid, Factor=remap_2.Clipped)  # -> Geometry, Transform
clean = CleanTree(RemoveNulls=True, RemoveInvalid=True, RemoveEmpty=False, Tree=scale_2.Geometry)
volume_2 = Volume(Geometry=scale_2.Geometry)  # -> Volume, Centroid
mesh = Mesh(scale_2.Geometry)
mesh_2 = Mesh(scale.Geometry)
prox = Proximity3D(Points=volume_2.Centroid, Group=5)  # -> Links, Topology
demesh = DeconstructMesh(Mesh=mesh)  # -> Vertices, Faces, Colours, Normals; disabled
debrep = DeconstructBrep(Brep=clean)  # -> Faces, simplify(Edges), Vertices
bbox_2 = BoundingBox(Content=scale_2.Geometry, Plane=PlaneXY(0, 0, 0), UnionBox=True)  # -> Box, Box_2
branch = TreeBranch(Tree=debrep.Edges, Path="{2}", MaintainPaths=True)
debox = DeconstructBox(Box=bbox_2.Box)  # -> Plane, X, Y, Z
line = Line(debrep.Edges)
dedomain = DeconstructDomain(Domain=debox.Z)  # -> Start, End
number_slider_3 = Slider(0.08, range=0..0.1)  # disabled
number_slider_4 = Slider(0.04, range=0..0.1)  # disabled
number_slider_5 = Slider(0.3, range=0..1)  # disabled
pt_3 = ConstructPoint(XCoordinate=0, YCoordinate=0, ZCoordinate=dedomain.End)
xy = XYPlane(Origin=pt_3)
exo = Exoskeleton(
    Lines=flatten(line),
    Sides=6,
    Thickness=number_slider_4,
    NodeSize=number_slider_3,
    Knuckle=number_slider_5,
    Spacing=3,
    Open=False)  # disabled
project = Project(Geometry=volume_2.Centroid, Plane=xy)  # -> Geometry, Transform
panel_3 = Panel("http://www.grasshopper3d.com/profiles/blogs/introducing-exoskeleton-a-wireframe-thickening-tool#comments")
ln = Line(StartPoint=volume_2.Centroid, EndPoint=project.Geometry)
exo_2 = Exoskeleton(
    Lines=ln,
    Sides=6,
    Thickness=Slider(0.05, range=0..1),
    NodeSize=Slider(0.1, range=0..0.1),
    Knuckle=Slider(0.48, range=0..1),
    Spacing=Slider(7, range=0..10),
    Open=False)
